# Grasshopper definition M3 1.gh (Grasshopper 1.0.8)

number_slider = Slider(2.3, range=0..5)
number_slider_2 = Slider(3, range=0..5)
xy_plane = XYPlane(Origin=Point(0, 0, 0))
number_slider_3 = Slider(3, range=0..5)
construct_point = ConstructPoint(XCoordinate=number_slider, YCoordinate=number_slider, ZCoordinate=number_slider_3)
rectangle = Rectangle(Plane=xy_plane, XSize=Slider(2, range=0..5), YSize=number_slider_2, Radius=Slider(1, range=0..1))  # -> Rectangle, Length
unit_z = UnitZ(Factor=number_slider_3)
sphere = Sphere(Base=construct_point, Radius=Slider(2, range=0..3))
boundary_surfaces = BoundarySurfaces(Edges=rectangle.Rectangle)
offset_surface = OffsetSurface(Surface=sphere, Distance=0, Retrim=True)
extrude = Extrude(Base=boundary_surfaces, Direction=unit_z)
xy_plane_2 = XYPlane(Origin=Point(0, 0, 0))
brep = Brep(offset_surface)
brep_2 = Brep(extrude)
trim_solid = TrimSolid(Shape=brep_2, Cutters=brep)
construct_point_2 = ConstructPoint(XCoordinate=0, YCoordinate=number_slider_2, ZCoordinate=0)
brep_3 = Brep(trim_solid)
cap_holes_ex = CapHolesEx(Brep=brep_3)  # -> Brep, Caps, Solid
xz_plane = XZPlane(Origin=construct_point_2)
mesh = Mesh(cap_holes_ex.Brep)
mirror = Mirror(Geometry=mesh, Plane=xz_plane)  # -> Geometry, Transform
